# Grasshopper definition 10PRINT-IN-CLASS.ghx (Grasshopper 0.9.76)

number_slider = Slider(279, range=0..1000)
number_slider_2 = Slider(134, range=0..1000)
series = Series(Start=0, Step=1, Count=Slider(10, range=0..10))
series_2 = Series(Start=0, Step=1, Count=Slider(10, range=0..10))
sqgrid = Square(Plane=PlaneXY(0, 0, 0), Size=1, ExtentX=number_slider, ExtentY=number_slider_2)  # -> flatten(Cells), Points
crossref = CrossReference(ListA=series, ListB=series_2, CrossMode=1)  # -> ListA, ListB
multiplication = Multiplication(A=number_slider, B=number_slider_2)
cp = ControlPoints(Curve=sqgrid.Cells)  # -> Points, Weights, Knots
cpoly = ControlPolygon(Curve=sqgrid.Cells)  # -> Polygon, Points
pt = ConstructPoint(XCoordinate=crossref.ListA, YCoordinate=crossref.ListB, ZCoordinate=0)
random = Random(Range=Domain(0, 1), Number=multiplication, Seed=2)
item = ListItem(List=cpoly.Points, Index=1, Wrap=True)
item_2 = ListItem(List=cpoly.Points, Index=3, Wrap=True)
item_3 = ListItem(List=cpoly.Points, Index=0, Wrap=True)
item_4 = ListItem(List=cpoly.Points, Index=2, Wrap=True)
larger = LargerThan(FirstNumber=random, SecondNumber=0.5)  # -> LargerThan, OrEqualTo
ln = Line(StartPoint=item, EndPoint=item_2)
ln_2 = Line(StartPoint=item_3, EndPoint=item_4)
panel = Panel(larger.LargerThan)
p_n_c = PickNChoose(Pattern=larger.LargerThan, Stream0=flatten(ln_2), Stream1=flatten(ln))
