# Grasshopper definition 10PRINT.ghx (Grasshopper 1.0.4)

size_x = Slider(100, range=0..100)
size_y = Slider(100, range=0..100)
step_size = Slider(1, range=0..10)
series = Series(Start=0, Step=step_size, Count=size_x)
series_2 = Series(Start=0, Step=step_size, Count=size_y)
multiplication = Multiplication(A=size_x, B=size_y)

pt = ConstructPoint(XCoordinate=1, YCoordinate=1, ZCoordinate=0)
pt_2 = ConstructPoint(XCoordinate=0, YCoordinate=0, ZCoordinate=0)
ln = Line(StartPoint=pt_2, EndPoint=pt)

pt_3 = ConstructPoint(XCoordinate=0, YCoordinate=1, ZCoordinate=0)
pt_4 = ConstructPoint(XCoordinate=1, YCoordinate=0, ZCoordinate=0)
ln_2 = Line(StartPoint=pt_3, EndPoint=pt_4)

random = Random(Range=Domain(0, 1), Number=multiplication, Seed=2)
crossref = CrossReference(ListA=series, ListB=series_2, CrossMode=1)  # -> ListA, ListB
larger = LargerThan(FirstNumber=random, SecondNumber=0.5)  # -> LargerThan, OrEqualTo
addition = Addition(A=crossref.ListA, B=step_size)
addition_2 = Addition(A=crossref.ListB, B=step_size)
long = LongestList(ListA=larger.LargerThan, ListB=ln, PaddingMode=2)  # -> ListA, ListB
int = Integer(larger.LargerThan)
long_2 = LongestList(ListA=larger.LargerThan, ListB=ln_2, PaddingMode=2)  # -> ListA, ListB
pt_5 = ConstructPoint(XCoordinate=crossref.ListA, YCoordinate=crossref.ListB, ZCoordinate=0)
pt_6 = ConstructPoint(XCoordinate=addition, YCoordinate=addition_2, ZCoordinate=0)
p_n_c = PickNChoose(Pattern=int, Stream0=long.ListB, Stream1=long_2.ListB)
rec_2pt = Rectangle2Pt(Plane=PlaneXY(0, 0, 0), PointA=pt_2, PointB=pt, Radius=0)  # -> Rectangle, Length
rec_2pt_2 = Rectangle2Pt(Plane=PlaneXY(0, 0, 0), PointA=pt_5, PointB=pt_6, Radius=0)  # -> Rectangle, Length
recmap = RectangleMapping(Geometry=p_n_c, Source=rec_2pt.Rectangle, Target=rec_2pt_2.Rectangle)  # -> Geometry, Transform
