# Grasshopper definition attractor.ghx (Grasshopper 0.9.76)

number_slider = Slider(1, range=0..100)
pt = Point(<point referenced from the Rhino model>)
series = Series(Start=0, Step=number_slider, Count=Slider(21, range=0..100))
series_2 = Series(Start=0, Step=number_slider, Count=Slider(21, range=0..100))
B = B(2)
crossref = CrossReference(ListA=series_2, ListB=series, CrossMode=1)  # -> ListA, ListB
division = Division(A=number_slider, B=B)
pt_2 = ConstructPoint(XCoordinate=crossref.ListA, YCoordinate=crossref.ListB, ZCoordinate=0)
subtraction = Subtraction(A=division, B=Slider(0.01, range=-1.02..1.01))
dom = ConstructDomain(DomainStart=0, DomainEnd=subtraction)
dist = Distance(PointA=pt, PointB=pt_2)
bnd = Bounds(Numbers=dist)
remap = RemapNumbers(Value=dist, Source=bnd, Target=dom)  # -> Mapped, Clipped
circle = CircleCNR(Center=pt_2, Normal=Vector(0, 0, 1), Radius=remap.Mapped)
