# Grasshopper definition bridge-grasshopper-starter.gh (Grasshopper 0.9.76)

number_slider = Slider(46, range=0..100)
series = Series(Start=0, Step=1, Count=number_slider)
series_2 = Series(Start=0, Step=1, Count=number_slider)
pt = ConstructPoint(XCoordinate=series_2, YCoordinate=0, ZCoordinate=0)
pt_2 = ConstructPoint(XCoordinate=0, YCoordinate=series, ZCoordinate=0)
rev = ReverseList(List=pt_2)
ln = Line(StartPoint=pt, EndPoint=rev)
