# Grasshopper definition bridge.gh (Grasshopper 0.9.76)
# plug-ins: Python Interpreter

number_slider = Slider(100, range=0..100)
python = PythonScript(x=number_slider, y=number_slider)  # -> out, a
# ---------- python: Python ----------
from Rhino.Geometry import *

lines = []

for i in range(0,100,10):
    lines.append(Line(Point3d(i,0,0),Point3d(x,i,0)))
    lines.append(Line(Point3d(0,i,0),Point3d(i,x,0)))
    lines.append(Line(Point3d(0,y-i,0),Point3d(i,0,0)))
    lines.append(Line(Point3d(x, y-i, 0),Point3d(i, x, 0)))
a=lines
# ---------- end python ----------
