# Grasshopper definition HOUSE-OF-DUST.ghx (Grasshopper 1.0.4)

panel = Panel("""sand
glass
stone
weeds
leaves
tin
wood
straw
plastic
dust""")
panel_2 = Panel("""by the sea
in a place with both heavy rain and bright sun
underwater
in a desert
in a cold windy climate
in an overpopulated area
among small hills
by an abandoned lake
in michigan""")
panel_3 = Panel("""using natural light
using all available lighting
using electricity
using candles""")
panel_4 = Panel("""inhabited by horses and birds
inhabited by various birds and fish
inhabited by american indians
inhabited by lovers
inhabited by people who eat a great deal
inhabited by french and german speaking people
inhabited by collectors of all types
inhabited by people who sleep almost all the time
inhabited by friends and enemies""")
expression = Expression(x=panel, Expression="Format(\"a house of {0}\", x)")
crossref = CrossReference(ListA=expression, ListB=panel_2, ListC=panel_3, ListD=panel_4, CrossMode=1)  # -> ListA, ListB, ListC, ListD, ListE
weave = Weave(
    Pattern=[0, 1, 2, 3, 4],
    Stream0=crossref.ListA,
    Stream1=crossref.ListB,
    Stream2=crossref.ListC,
    Stream3=crossref.ListD,
    Stream4=crossref.ListE,
    NullGaps=False)
panel_5 = Panel(weave)
