# Grasshopper definition img-mapper.ghx (Grasshopper 0.9.76)

# Brett Ian Balogh
# SAIC
# Embodying Code SP18
# Image Mapper
number_slider = Slider(100, range=0..100)
number_slider_2 = Slider(1, range=0..100)
pt = Point(<point referenced from the Rhino model>)
series = Series(Start=0, Step=number_slider_2, Count=Slider(100, range=0..100))
series_2 = Series(Start=0, Step=number_slider_2, Count=number_slider)
B = B(2)
crossref = CrossReference(ListA=series_2, ListB=series, CrossMode=1)  # -> ListA, ListB
division = Division(A=number_slider_2, B=B)
pt_2 = ConstructPoint(XCoordinate=crossref.ListA, YCoordinate=crossref.ListB, ZCoordinate=0)
subtraction = Subtraction(A=division, B=Slider(0.01, range=-1.02..1.01))
dom = ConstructDomain(DomainStart=0, DomainEnd=subtraction)
image = ImageSampler(
    pt_2,
    FilePath="C:\Users\Student\Desktop\index.png",
    Filter="Value",
    Interpolate=False,
    Umax=100,
    Umin=1,
    Vmax=100,
    Vmin=1,
    Wrap=1)
bnd = Bounds(Numbers=image)
remap = RemapNumbers(Value=image, Source=bnd, Target=dom)  # -> Mapped, Clipped
circle = CircleCNR(Center=pt_2, Normal=Vector(0, 0, 1), Radius=remap.Mapped)
panel = Panel(image)
