# Grasshopper definition plunge-halftone.ghx (Grasshopper 0.9.76)

number_slider = Slider(12, range=0..100)
series = Series(Start=0, Step=number_slider, Count=Slider(20, range=0..300))
series_2 = Series(Start=0, Step=number_slider, Count=Slider(10, range=0..300))
crossref = CrossReference(ListA=series, ListB=series_2, CrossMode=1)  # -> ListA, ListB
pt = ConstructPoint(XCoordinate=crossref.ListA, YCoordinate=crossref.ListB, ZCoordinate=0)
retract = Slider(5, range=0..10)
tool_diameter = Slider(4.76, range=0..10)
image = ImageSampler(
    pt,
    FilePath="C:\Users\Student\Desktop\WEEK 07\Radiolaria_03.png",
    Filter="Value",
    Interpolate=False,
    Umax=20,
    Umin=0,
    Vmax=10,
    Vmin=0,
    Wrap=1)
panel = Panel(image)
multiplication = Multiplication(A=image, B=tool_diameter)
division = Division(A=multiplication, B=2)
neg = Negative(Value=division)
pt_2 = ConstructPoint(XCoordinate=crossref.ListA, YCoordinate=crossref.ListB, ZCoordinate=neg)
panel_2 = Panel(neg)
split = SplitList(List=pt_2, Index=1)  # -> ListA, ListB
pdecon = Deconstruct(Point=split.ListB)  # -> XComponent, YComponent, ZComponent
pdecon_2 = Deconstruct(Point=split.ListA)  # -> XComponent, YComponent, ZComponent
expression = Expression(
    x=pdecon.XComponent,
    y=pdecon.YComponent,
    z=pdecon.ZComponent,
    Expression="Format(\"X{0:0.00} Y{1:0.00} Z{2:0.00}\", x, y, z)")
panel_3 = Panel("""(Plunge Halftone)
G0 G17 G80 G90
G21""")
expression_2 = Expression(
    x=pdecon_2.XComponent,
    y=pdecon_2.YComponent,
    z=pdecon_2.ZComponent,
    r=retract,
    f=Slider(2000, range=0..10000),
    Expression="Format(\"G81 X{0:0.00} Y{1:0.00} Z{2:0.00} R{3:0.00} F{4:0}\", x, y, z, r, f)")
merge = Merge(Data1=flatten(panel_3), Data2=flatten(expression_2), Data3=flatten(expression), Data4=flatten("M30"))
panel_4 = Panel(merge)
