# Grasshopper definition SCHOTTER.gh (Grasshopper 0.9.76)

number_slider = Slider(1, range=0..10)
number_slider_2 = Slider(1, range=0..10)
series = Series(Start=0, Step=number_slider_2, Count=Slider(10, range=0..100))
series_2 = Series(Start=0, Step=number_slider, Count=Slider(10, range=0..100))
crossref = CrossReference(ListA=series, ListB=series_2, CrossMode=1)  # -> ListA, ListB
division = Division(A=number_slider_2, B=2)
division_2 = Division(A=number_slider, B=2)
addition = Addition(A=crossref.ListB, B=division_2)
addition_2 = Addition(A=crossref.ListA, B=division)
pt = ConstructPoint(XCoordinate=addition_2, YCoordinate=addition, ZCoordinate=0)
neg = Negative(Value=division_2)
neg_2 = Negative(Value=division)
dom = ConstructDomain(DomainStart=neg, DomainEnd=division_2)
dom_2 = ConstructDomain(DomainStart=neg_2, DomainEnd=division)
rectangle = Rectangle(Plane=pt, XSize=dom_2, YSize=dom, Radius=0)  # -> Rectangle, Length
