# Grasshopper definition weather-surface.ghx (Grasshopper 0.9.76)

path = FilePath("C:\Users\Student\Desktop\weather-2005-2012.csv")
file = ReadFile(File=path, PerLineParse=True)
flip = FlipMatrix(Data=file)
split = TextSplit(Text=flip, Separators=",")
item = ListItem(List=split, Index=1, Wrap=True)  # -> flatten(Item)
item_2 = ListItem(List=split, Index=3, Wrap=True)  # -> flatten(Item)
dom = ConstructDomain(DomainStart=Slider(0, range=0..10000), DomainEnd=Slider(100, range=0..10000))
split_2 = SplitList(List=item, Index=1)  # -> ListA, ListB
split_3 = SplitList(List=item_2, Index=1)  # -> ListA, ListB
subset = SubList(List=split_3.ListB, Domain=dom, Wrap=True)  # -> List, Index
subset_2 = SubList(List=split_2.ListB, Domain=dom, Wrap=True)  # -> List, Index
lng = ListLength(List=subset_2.List)
panel = Panel(split_2.ListA)
panel_2 = Panel(split_2.ListB)
panel_3 = Panel(split_3.ListA)
panel_4 = Panel(split_3.ListB)
bnd = Bounds(Numbers=split_2.ListB)
series = Series(Start=0, Step=1, Count=lng)
bnd_2 = Bounds(Numbers=subset.List)
neg = Negative(Value=subset.List)
dom_2 = ConstructDomain(DomainStart=-0.5, DomainEnd=0.5)
pt = ConstructPoint(XCoordinate=series, YCoordinate=0, ZCoordinate=0)
remap = RemapNumbers(Value=split_2.ListB, Source=bnd, Target=Domain(0, 1))  # -> Mapped, Clipped
remap_2 = RemapNumbers(Value=subset.List, Source=bnd_2, Target=Domain(0, 1))  # -> Mapped, Clipped
series_2 = Series(Start=0, Step=1, Count=Slider(10, range=0..100))
series_3 = Series(Start=0, Step=1, Count=Slider(10, range=0..100))
rectangle = Rectangle(Plane=pt, XSize=dom_2, YSize=neg, Radius=0)  # -> Rectangle, Length
rectangle_2 = Rectangle(Plane=pt, XSize=dom_2, YSize=subset_2.List, Radius=0)  # -> Rectangle, Length
gradient = Gradient(
    LowerLimit=0,
    UpperLimit=1,
    Parameter=remap.Mapped,
    stops=[0: RGB(193, 186, 246), 0: RGB(255, 130, 160), 0: RGB(73, 96, 85), 0: RGB(39, 114, 158), 1: RGB(220, 0, 40)])
crossref = CrossReference(ListA=series_2, ListB=series_3, CrossMode=1)  # -> ListA, ListB
preview = CustomPreview(Geometry=rectangle_2.Rectangle, Shader=gradient)
pt_2 = ConstructPoint(XCoordinate=crossref.ListA, YCoordinate=crossref.ListB, ZCoordinate=remap_2.Mapped)
del = DelaunayMesh(Points=pt_2, Plane=PlaneXY(0, 0, 0))
